# Grasshopper definition Anti_aliasing_study.gh (Grasshopper 1.0.8)
# plug-ins: RhinoCodePluginGH

# ---- group: Disc with anti aliasing
number_slider = Slider(23.2, range=0..30)
number_slider_2 = Slider(9.4, range=0..30)
number_slider_3 = Slider(2.1, range=0..30)
aa_ofset = Slider(0.23, range=0..30)
number_slider_4 = Slider(22.152, range=0..30)
number_slider_5 = Slider(9.261, range=0..30)
c_script = CSharpScript(
    cx=number_slider,
    cy=number_slider_2,
    radius=number_slider_3,
    offset=aa_ofset,
    test_px=number_slider_4,
    test_py=number_slider_5)  # -> out, a, b; inputs cx: Double, cy: Double, radius: Double, offset: Double, test_px: Double, test_py: Double
# ---------- c_script: C# ----------
// Grasshopper Script Instance
#region Usings
using System;
using System.Linq;
using System.Collections;
using System.Collections.Generic;
using System.Drawing;

using Rhino;
using Rhino.Geometry;
using function;

using Grasshopper;
using Grasshopper.Kernel;
using Grasshopper.Kernel.Data;
using Grasshopper.Kernel.Types;
#endregion

public class Script_Instance : GH_ScriptInstance
{
    #region Notes
    /* 
      Members:
        RhinoDoc RhinoDocument
        GH_Document GrasshopperDocument
        IGH_Component Component
        int Iteration

      Methods (Virtual & overridable):
        Print(string text)
        Print(string format, params object[] args)
        Reflect(object obj)
        Reflect(object obj, string method_name)
    */
    #endregion

    private void RunScript(
		double cx,
		double cy,
		double radius,
		double offset,
		double test_px,
		double test_py,
		ref object a,
		ref object b)
    {
        // Define Gh Visual Representation Reference.
        Circle cic = new Circle(new Point3d(cx,cy,0),radius);
        // double dx = Math.Sqrt((radius*radius) + (radius*radius));
        // Define Draw Area.
        Point3d[] pt_array = new Point3d[4];
        // AA Offset.
        double radius_offset = radius + offset;
        pt_array[0] = new Point3d(cx-radius_offset,cy-radius_offset,0);
        pt_array[1] = new Point3d(cx+radius_offset,cy-radius_offset,0);
        pt_array[2] = new Point3d(cx+radius_offset,cy+radius_offset,0);
        pt_array[3] = new Point3d(cx-radius_offset,cy+radius_offset,0);
        // Compute Dx and Dy.
        double dx = cx - test_px;
        double dy = cy - test_py; 
        double sqaured_distance = (dx * dx) +  (dy * dy);
        Console.WriteLine("Raw Distance -> {0}",Math.Sqrt(sqaured_distance));
        Console.WriteLine("Out Distance from Radius -> {0}",Math.Sqrt(sqaured_distance)-radius);
        double distance = Math.Clamp(offset - Math.Clamp(Math.Sqrt(sqaured_distance+(offset*2))-radius,0,offset),0.0,1.0);
        Console.WriteLine("Improved Alpha: -> {0}",1-Math.Clamp(utility.Remap(Math.Sqrt(sqaured_distance)-radius,0,offset,0,1.0),0,1.0));
        a = cic;
        b = pt_array;
    }
}
namespace function
{
    class utility
    {
        static public double  Remap(double value, double fromMin, double fromMax, double toMin, double toMax)
        {
            // Ensure fromMin != fromMax to avoid division by zero
            if (fromMin == fromMax)
            {
                throw new ArgumentException("Source range cannot have zero length");
            }
            return toMin + (value - fromMin) * (toMax - toMin) / (fromMax - fromMin);
        }
    }
}
# ---------- end c_script ----------
panel = Panel(c_script.b)

pt = ConstructPoint(XCoordinate=number_slider, YCoordinate=number_slider_2, ZCoordinate=0)
pt_2 = ConstructPoint(XCoordinate=number_slider_4, YCoordinate=number_slider_5, ZCoordinate=0)
addition = Addition(A=number_slider_3, B=aa_ofset)
cir = Circle(Plane=pt, Radius=addition)
ln = Line(StartPoint=pt, EndPoint=pt_2)

panel_2 = Panel([c_script.out, ln])

# ---- group: Circle with thickness and Antialiasing
number_slider_6 = Slider(0.232, range=0..1)
number_slider_7 = Slider(5, range=0..30)
number_slider_8 = Slider(4.5, range=0..30)
aa_ofset_2 = Slider(0.1, range=0..30)
number_slider_9 = Slider(5, range=0..30)
number_slider_10 = Slider(1.018, range=0..30)
number_slider_11 = Slider(5, range=0..30)
c_script_2 = CSharpScript(
    cx=number_slider_7,
    cy=number_slider_11,
    radius=number_slider_8,
    thickness=number_slider_6,
    offset=aa_ofset_2,
    test_px=number_slider_9,
    test_py=number_slider_10)  # -> out, a, c, b; inputs cx: Double, cy: Double, radius: Double, thickness: Double, offset: Double, test_px: Double, test_py: Double
# ---------- c_script_2: C# ----------
// Grasshopper Script Instance
#region Usings
using System;
using System.Linq;
using System.Collections;
using System.Collections.Generic;
using System.Drawing;

using Rhino;
using Rhino.Geometry;
using function;

using Grasshopper;
using Grasshopper.Kernel;
using Grasshopper.Kernel.Data;
using Grasshopper.Kernel.Types;
#endregion

public class Script_Instance : GH_ScriptInstance
{
    #region Notes
    /* 
      Members:
        RhinoDoc RhinoDocument
        GH_Document GrasshopperDocument
        IGH_Component Component
        int Iteration

      Methods (Virtual & overridable):
        Print(string text)
        Print(string format, params object[] args)
        Reflect(object obj)
        Reflect(object obj, string method_name)
    */
    #endregion

    private void RunScript(
		double cx,
		double cy,
		double radius,
		double thickness,
		double offset,
		double test_px,
		double test_py,
		ref object a,
		ref object c,
		ref object b)
    {
        // Define Gh Visual Representation Reference.
        Circle cicA = new Circle(new Point3d(cx,cy,0),radius);
        Circle inner_circle = new Circle(new Point3d(cx,cy,0),radius-thickness);
        // double dx = Math.Sqrt((radius*radius) + (radius*radius));
        // Define Draw Area.
        Point3d[] pt_array = new Point3d[4];
        // AA Offset.
        double radius_offset = radius + offset;
        pt_array[0] = new Point3d(cx-radius_offset,cy-radius_offset,0);
        pt_array[1] = new Point3d(cx+radius_offset,cy-radius_offset,0);
        pt_array[2] = new Point3d(cx+radius_offset,cy+radius_offset,0);
        pt_array[3] = new Point3d(cx-radius_offset,cy+radius_offset,0);
        // Compute Dx and Dy.
        double dx = cx - test_px;
        double dy = cy - test_py; 
        double sqaured_distance = (dx * dx) +  (dy * dy);
        Console.WriteLine("Raw Distance -> {0}",Math.Sqrt(sqaured_distance));
        Console.WriteLine("Out Distance from Radius -> {0}",Math.Sqrt(sqaured_distance)-radius);
        double distance = Math.Clamp(offset - Math.Clamp(Math.Sqrt(sqaured_distance+(offset*2))-radius,0,offset),0.0,1.0);
        Console.WriteLine("Improved Alpha: -> {0}",1-Math.Clamp(utility.Remap(Math.Sqrt(sqaured_distance)-radius,0,offset,0,1.0),0,1.0));
        Console.WriteLine("Distance from inner cricle -> {0}",Math.Sqrt(sqaured_distance)-(radius-thickness));

        Console.WriteLine("Distance from inner cricle - aa threshold -> {0}",Math.Sqrt(sqaured_distance)-(radius-thickness-offset));
         Console.WriteLine("Improved inner Alpha: -> {0}",Math.Clamp(utility.Remap(Math.Sqrt(sqaured_distance)-(radius-thickness-offset),0,offset,0,1.0),0,1));
       
        a = cicA;
        c = inner_circle;
        b = pt_array;
    }
}
namespace function
{
    class utility
    {
        static public double  Remap(double value, double fromMin, double fromMax, double toMin, double toMax)
        {
            // Ensure fromMin != fromMax to avoid division by zero
            if (fromMin == fromMax)
            {
                throw new ArgumentException("Source range cannot have zero length");
            }
            return toMin + (value - fromMin) * (toMax - toMin) / (fromMax - fromMin);
        }
    }
}
# ---------- end c_script_2 ----------
panel_3 = Panel(c_script_2.b)

subtraction = Subtraction(A=number_slider_8, B=number_slider_6)
pt_3 = ConstructPoint(XCoordinate=number_slider_7, YCoordinate=number_slider_11, ZCoordinate=0)
pt_4 = ConstructPoint(XCoordinate=number_slider_9, YCoordinate=number_slider_10, ZCoordinate=0)
addition_2 = Addition(A=number_slider_8, B=aa_ofset_2)
subtraction_2 = Subtraction(A=subtraction, B=aa_ofset_2)
cir_2 = Circle(Plane=pt_3, Radius=addition_2)
cir_3 = Circle(Plane=pt_3, Radius=subtraction_2)
ln_2 = Line(StartPoint=pt_3, EndPoint=pt_4)

panel_4 = Panel([c_script_2.out, ln_2])
