# Grasshopper definition PerspectiveProjection.gh (Grasshopper 1.0.8)

fov = Slider(41.8, range=1..90)
dkrotation = Slider(154, range=0..360)
dkscale = Slider(0.7, range=0.1..2)
pt = Point(Point(4.490121949, 0.3023471218, 0.3042524274))
mesh = Mesh(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)

# ---- group: Build Furstrum Start Relative to 1 Unit of screen projection
rad = Radians(Degrees=fov)
vec = VectorXYZ(XComponent=Slider(1, range=0..1), YComponent=Slider(0, range=0..1), ZComponent=Slider(0, range=0..1))  # -> unitize(Vector), Length
expression = Expression(Fov=rad, Expression="1/(tan(Fov*0.5))")
rad_2 = Radians(Degrees=fov)
vec_2 = VectorXYZ(XComponent=Slider(1, range=0..1), YComponent=Slider(0, range=0..1), ZComponent=Slider(0, range=0..1))  # -> unitize(Vector), Length
expression_2 = Expression(Fov=rad_2, Expression="1/(tan(Fov*0.5))")
amp = Amplitude(Vector=vec.Vector, Amplitude=expression)
amp_2 = Amplitude(Vector=vec_2.Vector, Amplitude=expression_2)

# ---- group: Projection Vector
pt_2 = ConstructPoint(XCoordinate=Slider(0, range=0..10), YCoordinate=Slider(0, range=0..10), ZCoordinate=Slider(0, range=0..10))
addition = Addition(A=pt_2, B=amp_2)
Z = UnitZ(Factor=1)
addition_2 = Addition(A=addition, B=Z)
vec2pt = Vector2Pt(PointA=pt_2, PointB=addition_2, Unitize=False)  # -> Vector, Length
yz = YZPlane(Origin=addition)

# ---- group: Draw the camera in 3d
Y = UnitY(Factor=1)
addition_3 = Addition(A=pt_2, B=amp)
Z_2 = UnitZ(Factor=1)
addition_4 = Addition(A=addition_3, B=Y)
addition_5 = Addition(A=addition_4, B=Z_2)
vec2pt_2 = Vector2Pt(PointA=pt_2, PointB=addition_4, Unitize=False)  # -> Vector, Length
angle = Angle(VectorA=vec2pt_2.Vector, VectorB=amp)  # -> Angle, Reflex
merge = Merge(Data1=addition_4, Data2=addition_5, Data3=addition_2)
vdis = VectorDisplay(Anchor=pt_2, Vector=[amp, vec2pt_2.Vector])
vdis_2 = VectorDisplay(Anchor=pt_2, Vector=[amp_2, vec2pt.Vector])
pline = PolyLine(Vertices=merge, Closed=False)

# ---- group: Projection algorithm
xy = XYPlane(Origin=pt)
xy_2 = XYPlane(Origin=Point(0, 0, 0))
rad_3 = Radians(Degrees=dkrotation)
orient = Orient(Geometry=mesh, Source=xy_2, Target=xy)  # -> Geometry, Transform
rotate = Rotate(Geometry=orient.Geometry, Angle=rad_3, Plane=xy)  # -> Geometry, Transform
scale = Scale(Geometry=rotate.Geometry, Center=xy, Factor=dkscale)  # -> Geometry, Transform
demesh = DeconstructMesh(Mesh=scale.Geometry)  # -> Vertices, Faces, Colours, Normals
pdecon = Deconstruct(Point=demesh.Vertices)  # -> XComponent, YComponent, ZComponent
expression_3 = Expression(y=pdecon.ZComponent, z=pdecon.XComponent, Fov=rad_2, Expression="y/(z*tan(Fov*0.5))")
# Credit: Carl the Person Youtube thx to him
expression_4 = Expression(x=pdecon.YComponent, z=pdecon.XComponent, Fov=rad_2, Expression="x/(z*tan(Fov*0.5))")
pt_3 = PointOriented(BasePlane=yz, UComponent=expression_4, VComponent=expression_3, WComponent=0)

# ---- group: Fov Angle
angle_2 = Angle(VectorA=vec2pt.Vector, VectorB=amp_2)  # -> Angle, Reflex
deg = Degrees(Radians=angle_2.Angle)  # -> expr("x*2", Degrees)
panel = Panel(deg)
