# Grasshopper definition ProjectedLength.gh (Grasshopper 1.0.8)

pln = Plane(Plane(origin=(9.350279572, 4.160782844, -12.5136559), x=(-0.4335954104, 0.9011076629, 0), y=(0.6652373371, 0.3200992157, -0.6745337482)))
crv = Curve(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)

# ---- group: CPlane components
deplane = DeconstructPlane(Plane=pln)  # -> Origin, XAxis, YAxis, ZAxis
pt = Point(deplane.Origin)
vdis = VectorDisplay(Anchor=deplane.Origin, Vector=deplane.ZAxis)

# ---- group: Vector from Line
end = EndPoints(Curve=crv)  # -> Start, End
vec2pt = Vector2Pt(PointA=end.Start, PointB=end.End, Unitize=False)  # -> Vector, Length

# ---- group: Projected Length
expression = Expression(vec=vec2pt.Vector, normal=deplane.ZAxis, Expression="(normal*(vec*normal))")
vdis_2 = VectorDisplay(Anchor=deplane.Origin, Vector=expression)

# ---- group: Input Vector minus Projected Length
expression_2 = Expression(vec=vec2pt.Vector, normal=deplane.ZAxis, Expression="vec - (normal*(vec*normal))")
addition = Addition(A=deplane.Origin, B=expression_2)
