# Grasshopper definition RayCasting.gh (Grasshopper 1.0.8)

md_slider = MDSlider(SliderMode=0, slider_value=Point(0, 0, 0.5), x_domain=Domain(0, 1), y_domain=Domain(0, 1), z_domain=Domain(0, 1))
srf = Surface(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)
crv = Curve(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)
end = EndPoints(Curve=crv)  # -> Start, End
evalsrf = EvaluateSurface(Surface=reparameterize(srf), Point=md_slider)  # -> Point, Normal, UDirection, VDirection, Frame
vec = Vector(unitize(evalsrf.Normal))
vec2pt = Vector2Pt(PointA=end.Start, PointB=end.End, Unitize=False)  # -> Vector, Length
vec2pt_2 = Vector2Pt(PointA=end.Start, PointB=evalsrf.Point, Unitize=False)  # -> Vector, Length
ln = Line(StartPoint=end.Start, EndPoint=evalsrf.Point)
dprod = DotProduct(VectorA=vec2pt_2.Vector, VectorB=vec, Unitize=False)
dprod_2 = DotProduct(VectorA=vec2pt.Vector, VectorB=evalsrf.Normal, Unitize=False)
vdis = VectorDisplay(Anchor=end.Start, Vector=vec2pt.Vector)
division = Division(A=dprod, B=dprod_2)
multiplication = Multiplication(A=vec2pt.Vector, B=division)
addition = Addition(A=multiplication, B=end.Start)
panel = Panel(addition)
