# Grasshopper definition RayTracePrimitveShaderStudy.gh (Grasshopper 1.0.8)

# ---- group: RayTrace / (Bake those two input to extract)
mesh = Mesh(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)
crv = Curve(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)

# ---- group: RayTrace
demesh = DeconstructMesh(Mesh=mesh)  # -> Vertices, Faces, Colours, Normals
facen = FaceNormals(Mesh=mesh)  # -> Centers, Normals
unit = UnitVector(Vector=facen.Normals)
deface = DeconstructFace(Face=demesh.Faces)  # -> CornerA, CornerB, CornerC, CornerD
item = ListItem(List=demesh.Vertices, Index=deface.CornerA, Wrap=True)
end = EndPoints(Curve=crv)  # -> Start, End
subtraction = Subtraction(A=item, B=end.Start)
subtraction_2 = Subtraction(A=end.End, B=end.Start)
vdis = VectorDisplay(Anchor=end.Start, Vector=subtraction_2)
dprod = DotProduct(VectorA=subtraction, VectorB=unit, Unitize=False)
dprod_2 = DotProduct(VectorA=subtraction_2, VectorB=unit, Unitize=False)
vdis_2 = VectorDisplay(Anchor=end.Start, Vector=subtraction)
division = Division(A=dprod, B=dprod_2)
multiplication = Multiplication(A=subtraction_2, B=division)
vdis_3 = VectorDisplay(Anchor=end.Start, Vector=multiplication)

# ---- group: Primitive shader
light_intensity = Slider(4.6, range=0..15)
colour = ColourPicker(PickedColour=RGB(209, 31, 94))
argb = SplitARGB(Colour=colour)  # -> Alpha, Red, Green, Blue
dprod_3 = DotProduct(VectorA=unitize(subtraction_2), VectorB=unit, Unitize=False)
vlen = VectorLength(Vector=multiplication)
expression = Expression(x=vlen, Expression="Format(\"Ray Distance: ({0:#0.000} unit(s))\",x)")
expression_2 = Expression(dist=vlen, dot=dprod_3, intensity=light_intensity, Expression="((1/Sqrt(dist))*dot)*intensity")
multiplication_2 = Multiplication(A=expression_2, B=argb.Green)
multiplication_3 = Multiplication(A=expression_2, B=argb.Blue)
multiplication_4 = Multiplication(A=expression_2, B=argb.Red)
panel = Panel(expression)
panel_2 = Panel(expression_2)
panel_3 = Panel(dprod_3)

# ---- group: The Logic
# - project the length of the ray vector on the face normal
# - project the length of (one of the face point) vector on the face normal
# - compute the aligned ratio
# - factorise ray vector by the aligned ratio
# - you get the intersection point
expression_3 = Expression(x=unit, Expression="-x")
multiplication_5 = Multiplication(A=expression_3, B=dprod_2)
multiplication_6 = Multiplication(A=expression_3, B=dprod)
vdis_4 = VectorDisplay(Anchor=facen.Centers, Vector=multiplication_6)
vdis_5 = VectorDisplay(Anchor=facen.Centers, Vector=multiplication_5)

# ---- group: Normalize Value Test
expression_4 = Expression(x=expression_2, max_v=Slider(0.5, range=0..1), min_v=Slider(0, range=0..1), Expression="(x-min_v)/(max_v-min_v)")
panel_4 = Panel(expression_4)

# ---- group: PixelColor
frgb = ColourRGBF(Alpha=1, Red=multiplication_4, Green=multiplication_2, Blue=multiplication_3)
addition = Addition(A=end.Start, B=multiplication)
dots = DotDisplay(Point=addition, Colour=frgb, Size=Slider(1, range=0..1))
