# Grasshopper definition combined_matrix.gh (Grasshopper 1.0.8)

# ---- group: How to multiply matrix
number_slider = Slider(4, range=0..4)
number_slider_2 = Slider(4, range=0..4)
panel = Panel("""-1.0
0.0
0.0
0.0
0.0
1.0
0.0
0.0
0.0
0.0
1.0
0.0
0.0
0.0
0.0
1.0""")
panel_2 = Panel("""1.0
0.0
0.0
4.5
0.0
1.0
0.0
4.5
0.0
0.0
1.0
0.0
0.0
0.0
0.0
1.0""")
matrix = ConstructMatrix(Rows=number_slider, Columns=number_slider, Values=panel)
matrix_2 = ConstructMatrix(Rows=number_slider_2, Columns=number_slider_2, Values=panel_2)
multiplication = Multiplication(A=matrix, B=matrix_2)
expression = Expression(Expression="(-1.0*4.5)+(0.0*4.5)+(0.0*0.0)+(0.0*1.0)")
expression_2 = Expression(Expression="(0.0*4.5)+(1.0*4.5)+(0.0*0.0)+(0.0*1.0)")
panel_3 = Panel(expression_2)
panel_4 = Panel(expression)

# ----
number_slider_3 = Slider(4, range=0..4)
number_slider_4 = Slider(4, range=0..4)

# ---- group: two Input point
pt = ConstructPoint(XCoordinate=Slider(1, range=0..1), YCoordinate=Slider(1, range=0..1), ZCoordinate=Slider(0, range=0..1))
pt_2 = ConstructPoint(XCoordinate=Slider(1, range=0..1), YCoordinate=Slider(0, range=0..1), ZCoordinate=Slider(0, range=0..1))
pt_3 = Point([pt, pt_2])

# ----
panel_5 = Panel("""1.0
0.0
0.0
-0.25
0.0
1.0
0.0
-0.25
0.0
0.0
1.0
0.0
0.0
0.0
0.0
1.0""")
panel_6 = Panel("""-1.0
0.0
0.0
0.0
0.0
1.0
0.0
0.0
0.0
0.0
1.0
0.0
0.0
0.0
0.0
1.0""")
matrix_3 = ConstructMatrix(Rows=number_slider_3, Columns=number_slider_3, Values=panel_6)
matrix_4 = ConstructMatrix(Rows=number_slider_4, Columns=number_slider_4, Values=panel_5)

# ---- group: Rotate 90 deg left
rotate_90_left = DisplayMatrix(matrix_3)

# ---- group: Translation of -1/4 on (x,y)
rotate_90_left_2 = DisplayMatrix(matrix_4)

# ---- group: How to multiply matrix / Rotate 90 deg left
rotate_90_left_3 = DisplayMatrix(matrix)

# ---- group: How to multiply matrix / Translate diagonal up by 4.5
rotate_90_left_4 = DisplayMatrix(matrix_2)

# ----
expression_3 = Expression(pt=pt_2, Expression="(pt.X*-1.00)+(pt.Y*0.0)+(pt.Z*0.0)+(0.25*1.0)")
expression_4 = Expression(pt=pt_2, Expression="(pt.X*0.0)+(pt.Y*1.0)+(pt.Z*0.0)+(-0.25*1.0)")
expression_5 = Expression(pt=pt_2, Expression="(pt.X*0.0)+(pt.Y*0.0)+(pt.Z*1.0)+(0.0*1.0)")
expression_6 = Expression(pt=pt, Expression="(pt.X*-1.00)+(pt.Y*0.0)+(pt.Z*0.0)+(0.25*1.0)")
expression_7 = Expression(pt=pt, Expression="(pt.X*0.0)+(pt.Y*1.0)+(pt.Z*0.0)+(-0.25*1.0)")
expression_8 = Expression(pt=pt, Expression="(pt.X*0.0)+(pt.Y*0.0)+(pt.Z*1.0)+(0.0*1.0)")
pt_4 = ConstructPoint(XCoordinate=expression_3, YCoordinate=expression_4, ZCoordinate=expression_5)
pt_5 = ConstructPoint(XCoordinate=expression_6, YCoordinate=expression_7, ZCoordinate=expression_8)

# ---- group: Combined Transformation
multiplication_2 = Multiplication(A=matrix_3, B=matrix_4)
display_matrix = DisplayMatrix(multiplication_2)

# ----
expression_9 = Expression(Expression="(-1.0*1.0)+(0.0*0.0)+(0.0*0.0)+(0.0*0.0)")

# ---- group: sum of the distributed product of the input point
transform = Transform(Geometry=pt_3, Transform=multiplication_2)

# ---- group: How to multiply matrix / matrix A x B (Combined transformation)
rotate_90_left_5 = DisplayMatrix(multiplication)

# ----
panel_7 = Panel(expression_9)
panel_8 = Panel(transform)
panel_9 = Panel([pt_5, pt_4])
