# Grasshopper definition MatrixRotation.gh (Grasshopper 1.0.8)

x_direction_point = Point(Point(1, 0, 0))
origin_point = Point(Point(0, 0, 0))
xy = XYPlane(Origin=Point(0, 0, 0))
vec2pt = Vector2Pt(PointA=origin_point, PointB=x_direction_point, Unitize=False)  # -> Vector, Length

# ---- group: Angle vector2D
number_slider = Slider(2, range=0..2)
number_slider_2 = Slider(0.6, range=0..2)
pt = ConstructPoint(XCoordinate=number_slider, YCoordinate=number_slider_2, ZCoordinate=0)

# ----
vec2pt_2 = Vector2Pt(PointA=origin_point, PointB=pt, Unitize=False)  # -> Vector, Length
cluster = Cluster(A_3=origin_point, A_2=pt, A=number_slider, A_4=pt, x=number_slider_2, y=number_slider)  # -> L, L_2, R
linedim = LineDimension(Line=[cluster.L, cluster.L_2], Text="{0:0.00}", Size=cluster.R)
angle = Angle(VectorA=vec2pt.Vector, VectorB=vec2pt_2.Vector)  # -> Angle, Reflex
angledim = AngularDimension(Center=origin_point, PointA=pt, PointB=vec2pt.Vector, Reflex=False, Text="{0:0.0}°", Size=cluster.R)

# ---- group: Angle vector2D (continued)
vec = Vector(vec2pt_2.Vector)

# ----
point_to_rotate = ConstructPoint(XCoordinate=Slider(1.6, range=0..10.1), YCoordinate=Slider(1.3, range=0..10.1), ZCoordinate=0)

rotate = Rotate(Geometry=point_to_rotate, Angle=angle.Angle, Plane=xy)  # -> Geometry, Transform
pdecon = Deconstruct(Point=rotate.Geometry)  # -> XComponent, YComponent, ZComponent
pdecon_2 = Deconstruct(Point=point_to_rotate)  # -> XComponent, YComponent, ZComponent

# ---- group: Matrix Rotation from Z axis
expression = Expression(
    x=pdecon_2.XComponent,
    y=pdecon_2.YComponent,
    z=pdecon_2.ZComponent,
    Alpha=angle.Angle,
    Expression="(cos(Alpha)*x) + (-sin(Alpha)*y) + (z*0*z ) + (1*0)")
expression_2 = Expression(
    x=pdecon_2.XComponent,
    y=pdecon_2.YComponent,
    z=pdecon_2.ZComponent,
    Alpha=angle.Angle,
    Expression="(sin(Alpha)*x) + (cos(Alpha)*y) + (z*0*z ) + (1*0)")
expression_3 = Expression(
    x=pdecon_2.XComponent,
    y=pdecon_2.YComponent,
    z=pdecon_2.ZComponent,
    Alpha=angle.Angle,
    Expression="(0*x) + (0*y) + (1*z ) + (1*0)")
matrix = TransformMatrix(rotate.Transform, Digits=3)
cos = Cosine(Value=angle.Angle)
sin = Sine(Value=angle.Angle)
unit = UnitVector(Vector=vec)
panel = Panel(unit)
panel_2 = Panel(cos)
panel_3 = Panel(sin)
expression_4 = Expression(
    x=pdecon.XComponent,
    y=pdecon.YComponent,
    z=pdecon.ZComponent,
    Expression="Format(\"Expected Result: x:{0:#0.00},y:{1:#0.00},z:{2:#0.00}\", x, y, z)")
expression_5 = Expression(
    x=expression,
    y=expression_2,
    z=expression_3,
    Expression="Format(\"Matrix   Result: x:{0:#0.00},y:{1:#0.00},z:{2:#0.00}\", x, y, z)")
panel_4 = Panel([expression_5, expression_4])

# ---- group: Angle vector2D (continued)
vdis = VectorDisplay(Anchor=origin_point, Vector=unit)

# ----
rotated_point = Point(rotate.Geometry)

# ---- group: Matrix Basis Axes Transformation.
pt_2 = ConstructPoint(XCoordinate=expr("-x", sin), YCoordinate=cos, ZCoordinate=0)
pt_3 = ConstructPoint(XCoordinate=cos, YCoordinate=sin, ZCoordinate=0)

# ----
angledim_2 = AngularDimension(Center=origin_point, PointA=point_to_rotate, PointB=rotated_point, Reflex=False, Text="{0:0.0}°", Size=cluster.R)

# ==== cluster Cluster
x = ClusterInput()
y = ClusterInput()
X = UnitX(Factor=1)
A = ClusterInput()
expression = Expression(x=x, y=y, Expression="((x+y)/2)*0.05")
A_2 = ClusterInput()
amp = Amplitude(Vector=X, Amplitude=A)
A_3 = ClusterInput()
A_4 = ClusterInput()
subtraction = Subtraction(A=A_2, B=amp)
R = ClusterOutput(expression)
ln = Line(StartPoint=A_3, EndPoint=subtraction)
ln_2 = Line(StartPoint=A_4, EndPoint=subtraction)
L = ClusterOutput(ln)
L_2 = ClusterOutput(ln_2)
